# Grasshopper definition gHowl_UDP_send+receive.ghx (Grasshopper 0.9.75)
# plug-ins: Anemone, gHowl

port = Panel("7001")
# Import string from Processing
udp_owl = UDPReceiver(Port=port, Pattern=0)  # -> Info, Data
panel = Panel(udp_owl.Data)
# Parse string into small text chunks
split = StringSplit(String=udp_owl.Data, Separators=";")
loop_start = LoopStart(Repeat=0, Data_0=split)  # -> port, Counter, Data_0
panel_2 = Panel(loop_start.Data_0)
# Split into groups of 4 numbers
# that define the geometry
partition = PartitionList(List=loop_start.Data_0, Size="4")
panel_3 = Panel(partition)
# Split into groups of 2 numbers
# that define the origin and size & draw box
loop_start_2 = LoopStart(Repeat=0, Data_0=partition)  # -> port, Counter, Data_0
split_2 = SplitList(List=loop_start_2.Data_0, Index=2)  # -> ListA, ListB
# for rect (x,y,w,h)
# where x,y is origin
# w,h is size
panel_4 = Panel("6")
split_3 = SplitList(List=split_2.ListA, Index=1)  # -> ListA, ListB
dom = ConstructDomain(DomainStart=panel_4, DomainEnd="24")
split_1 = SplitList(List=split_2.ListB, Index=1)  # -> ListA, ListB
pt = ConstructPoint(XCoordinate=split_3.ListA, YCoordinate=split_3.ListB, ZCoordinate=0)
random = Random(Range=dom, Number=1, Seed=2, Integers=True)
# try either domain box
# or center box!
box = DomainBox(Base=pt, X=split_1.ListA, Y=split_1.ListB, Z=random)
loop_end = LoopEnd(port=loop_start_2.port, Exit=False, Data_0=box, pausedState=False, state="Last & Record")
panel_5 = Panel(random)
loop_end_2 = LoopEnd(port=loop_start.port, Exit=False, Data_0=loop_end, pausedState=False, state="Last & Record")
panel_6 = Panel(loop_end_2)
